# Dynamo graph Materials_and_Types.dyn (Dynamo 3.3.0.6316)

load_db_from_pdf = Python()  # CPython3; unwired: IN[0]
# ---------- load_db_from_pdf.python (365 lines) ----------
# -*- coding: utf-8 -*-
import sys
import clr

try:
    clr.AddReference('RevitAPI')
    clr.AddReference('RevitServices')
    from Autodesk.Revit.DB import *
    from RevitServices.Persistence import DocumentManager
    from RevitServices.Transactions import TransactionManager
    doc = DocumentManager.Instance.CurrentDBDocument
    IN_REVIT = True
except ImportError:
    IN_REVIT = False
    print("This script must be run inside Revit.")

# ========================================================
# 1. MATERIALS & OPAQUE CONSTRUCTIONS (Updated with TAG)
# ========================================================
# Added the "CTE" tag to the logic
TAG_VALUE = "CTE"

PDF_CONSTRUCTIONS = {
    "MURO EXTERIOR": {
        "category": "Wall",
        "layers": [
            ("Mortero de cemento", 0.03, 0.550),
            ("EPS Poliestireno", 0.14, 0.038),
            ("1 pie LP métrico o catalán", 0.24, 0.667),
            ("Mortero de cemento", 0.01, 0.550),
            ("Cámara de aire sin ventilar vertical", 0.05, 0.180),
            ("Placa de yeso laminado", 0.015, 0.250),
            ("Placa de yeso laminado", 0.015, 0.250)
        ]
    },
    "MURO DE CÁMARA SANITARIA": {
        "category": "Wall",
        "layers": [
            ("Betún fieltro o lámina", 0.009, 0.230),
            ("1 pie LP métrico o catalán", 0.24, 0.667)
        ]
    },
    "TABIQUE INTERIOR": {
        "category": "Wall",
        "layers": [
            ("Placa de yeso laminado", 0.013, 0.250),
            ("Placa de yeso laminado", 0.013, 0.250),
            ("MW Lana mineral", 0.04, 0.041),
            ("Placa de yeso laminado", 0.013, 0.250),
            ("Placa de yeso laminado", 0.013, 0.250)
        ]
    },
    "FORJADO INTERIOR (ACOND-ACOND)": {
        "category": "Floor",
        "layers": [
            ("Plaqueta de gres", 0.01, 2.300),
            ("Mortero de cemento", 0.05, 0.550),
            ("Mortero de cemento de difusión", 0.065, 0.550),
            ("XPS Expandido", 0.06, 0.034),
            ("FU entrevigado cerámico", 0.25, 0.908),
            ("Cámara de aire sin ventilar horizontal", 0.05, 0.160),
            ("Placa de yeso laminado", 0.015, 0.250)
        ]
    },
    "FORJADO INTERIOR (ACOND-NO HAB)": {
        "category": "Floor",
        "layers": [
            ("Plaqueta de gres", 0.01, 2.300),
            ("Mortero de cemento", 0.055, 0.550),
            ("XPS Expandido", 0.12, 0.034),
            ("FU entrevigado cerámico", 0.25, 0.908),
            ("Cámara de aire sin ventilar horizontal", 0.05, 0.160),
            ("Placa de yeso laminado", 0.015, 0.250)
        ]
    },
    "FORJADO CON CÁMARA SANITARIA": {
        "category": "Floor",
        "layers": [
            ("Plaqueta de gres", 0.01, 2.300),
            ("Mortero de cemento", 0.025, 0.550),
            ("Mortero de cemento de difusión", 0.06, 0.550),
            ("XPS Expandido", 0.10, 0.034),
            ("Forjado Entrevigado EPS mecanizado", 0.30, 0.256),
            ("Lámina de cloruro de polivinilo (PVC)", 0.005, 0.170)
        ]
    },
    "SOLERA DE CÁMARA SANITARIA": {
        "category": "Floor",
        "layers": [
            ("Hormigón en masa", 0.08, 1.650),
            ("Lámina PVC", 0.003, 0.170),
            ("Arena y grava", 0.12, 2.000)
        ]
    },
    "CUBIERTA INCLINADA DE TEJA": {
        "category": "Roof",
        "layers": [
            ("Teja de arcilla cocida", 0.015, 1.000),
            ("Cámara aire ventilada, flujo ascend.", 0.05, 0.060),
            ("XPS Expandido", 0.16, 0.034),
            ("Betún fieltro o lámina", 0.01, 0.230),
            ("Forjado Entrevigado EPS mecanizado", 0.25, 0.266),
            ("Placa de yeso laminado", 0.015, 0.250)
        ]
    }
}

# ========================================================
# 2. OPENINGS (WINDOWS & DOORS) FROM PDF
# ========================================================
# Data extracted from PDF pages 38-40
OPENINGS_DATA = {
    "Ventana N-E (CTE)": {
        "category": BuiltInCategory.OST_Windows,
        "description": "Vidrio: 4-16Ar-4 (Low-E <0.03), Ug=1.0, g=0.61 | Marco: PVC, Uf=1.5",
        "u_val": 1.5, # Approximate total Uw or Frame U
        "tag": "CTE"
    },
    "Ventana S-O (CTE)": {
        "category": BuiltInCategory.OST_Windows,
        "description": "Vidrio: 4-16Ar-4 (Low-E <0.03), Ug=1.0, g=0.42 | Marco: PVC, Uf=1.5",
        "u_val": 1.5,
        "tag": "CTE"
    },
    "Lucernario S-E (CTE)": {
        "category": BuiltInCategory.OST_Windows, # Usually modeled as Windows or Roof Windows
        "description": "Vidrio: 4-16Ar-4, Ug=1.0, g=0.42 | Marco: Madera, Uf=2.4",
        "u_val": 2.4,
        "tag": "CTE"
    },
    "Lucernario N (CTE)": {
        "category": BuiltInCategory.OST_Windows,
        "description": "Vidrio: 4-16Ar-4, Ug=1.0, g=0.61 | Marco: Madera, Uf=2.4",
        "u_val": 2.4,
        "tag": "CTE"
    },
    "Puerta Acceso (CTE)": {
        "category": BuiltInCategory.OST_Doors,
        "description": "Marco: Madera Densidad Media-Alta, Uf=2.2 | Opaca",
        "u_val": 2.2,
        "tag": "CTE"
    }
}

# ========================================================
# HELPER FUNCTIONS
# ========================================================
def m2ft(meters):
    return meters * 3.28084

def ensure_thermal_asset(doc, mat_element, k_val_si):
    therm_id = mat_element.ThermalAssetId
    if therm_id != ElementId.InvalidElementId: return

    try:
        asset_name = "Thermal_" + mat_element.Name
        t_asset = ThermalAsset(asset_name, ThermalMaterialType.Solid)
        val_internal = k_val_si * 0.3048
        t_asset.ThermalConductivity = val_internal
        pse = PropertySetElement.Create(doc, t_asset)
        mat_element.ThermalAssetId = pse.Id
    except Exception as e:
        print(f"Warning: Thermal set failed for {mat_element.Name}: {e}")

def get_or_create_material(doc, mat_name, k_val):
    col = FilteredElementCollector(doc).OfClass(Material)
    found_mat = None
    for m in col:
        if m.Name == mat_name:
            found_mat = m
            break
    
    if not found_mat:
        new_id = Material.Create(doc, mat_name)
        found_mat = doc.GetElement(new_id)
    
    # 1. Ensure Thermal
    ensure_thermal_asset(doc, found_mat, k_val)
    
    # 2. Ensure TAG (Comments)
    try:
        p_comm = found_mat.get_Parameter(BuiltInParameter.ALL_MODEL_DESCRIPTION) # Description
        # Or Comments: BuiltInParameter.ALL_MODEL_INSTANCE_COMMENTS 
        # Materials use ALL_MODEL_INSTANCE_COMMENTS for "Comments" field in UI? No, usually distinct.
        # Let's try finding parameter by name to be safe/lazy, or use specific BuiltIn
        
        # In Revit Materials, the "Comments" field is 'ALL_MODEL_INSTANCE_COMMENTS'
        p = found_mat.get_Parameter(BuiltInParameter.ALL_MODEL_INSTANCE_COMMENTS)
        if p and not p.IsReadOnly:
            p.Set(TAG_VALUE)
    except:
        pass
        
    return found_mat.Id

def get_template_type(doc, kind):
    # Kind is 'Wall', 'Floor', 'Roof'
    def get_safe_name(elem):
        try:
            p = elem.get_Parameter(BuiltInParameter.SYMBOL_NAME_PARAM)
            if p and p.HasValue: return p.AsString()
            return elem.Name
        except: return "UNKNOWN"

    col = FilteredElementCollector(doc)
    if kind == 'Wall': col.OfClass(WallType)
    elif kind == 'Floor': col.OfClass(FloorType)
    elif kind == 'Roof': col.OfClass(RoofType)
    col.WhereElementIsElementType()
    
    elements = list(col.ToElements())
    selected = None
    
    for t in elements:
        nm = get_safe_name(t)
        if "Generic" in nm or "Genérico" in nm or "Default" in nm:
            selected = t
            break
            
    if not selected and elements: selected = elements[0]
    return selected

def create_opening_types(doc):
    print("\n--- 3. CREATING WINDOW & DOOR TYPES ---")
    
    # Helper to find a family to duplicate
    def get_family_symbol(cat_enum):
        col = FilteredElementCollector(doc).OfCategory(cat_enum).WhereElementIsElementType()
        for s in col:
            # We want a symbol (Type), not the Family itself
            if isinstance(s, FamilySymbol):
                return s
        return None

    for name, info in OPENINGS_DATA.items():
        cat = info['category']
        
        # 1. Find a template to duplicate
        tmpl = get_family_symbol(cat)
        if not tmpl:
            print(f"SKIP {name}: No loaded families found for category.")
            continue
            
        # 2. Check if Type exists
        found_type = None
        col = FilteredElementCollector(doc).OfCategory(cat).WhereElementIsElementType()
        for t in col:
            # Check name
            try:
                t_name = t.get_Parameter(BuiltInParameter.SYMBOL_NAME_PARAM).AsString()
                if t_name == name:
                    found_type = t
                    break
            except: pass
        
        # 3. Duplicate
        if not found_type:
            try:
                found_type = tmpl.Duplicate(name)
                print(f"CREATED: {name}")
            except Exception as e:
                print(f"ERROR creating {name}: {e}")
                continue
        else:
            print(f"EXISTS: {name}")
            
        # 4. Set Metadata (Description & Tag)
        try:
            # Description
            p_desc = found_type.get_Parameter(BuiltInParameter.ALL_MODEL_DESCRIPTION)
            if p_desc: p_desc.Set(info['description'])
            
            # Type Comments (Tag)
            p_comm = found_type.get_Parameter(BuiltInParameter.ALL_MODEL_TYPE_COMMENTS)
            if p_comm: p_comm.Set(info['tag'])
            
        except Exception as e:
            print(f"  -> Warn: Could not set params for {name}")


def build_library():
    if not IN_REVIT: return
    
    TransactionManager.Instance.EnsureInTransaction(doc)
    print("--- 1. BUILDING MATERIALS (WITH TAGS) ---")
    
    material_cache = {}
    for type_name, data in PDF_CONSTRUCTIONS.items():
        for layer in data["layers"]:
            mat_name = layer[0]
            k_val = layer[2]
            if mat_name not in material_cache:
                mid = get_or_create_material(doc, mat_name, k_val)
                material_cache[mat_name] = mid
    print("Materials OK.")

    print("\n--- 2. BUILDING WALL/FLOOR/ROOF TYPES ---")
    
    wall_tmpl = get_template_type(doc, 'Wall')
    floor_tmpl = get_template_type(doc, 'Floor')
    roof_tmpl = get_template_type(doc, 'Roof')
    
    class_map = { 'Wall': WallType, 'Floor': FloorType, 'Roof': RoofType }

    for type_name, data in PDF_CONSTRUCTIONS.items():
        kind = data["category"]
        tmpl = None
        if kind == 'Wall': tmpl = wall_tmpl
        elif kind == 'Floor': tmpl = floor_tmpl
        elif kind == 'Roof': tmpl = roof_tmpl
        
        if not tmpl: continue

        target_class = class_map.get(kind)
        target_type = None
        
        # Find existing
        col = FilteredElementCollector(doc).OfClass(target_class).WhereElementIsElementType()
        for t in col:
            t_name = "UNKNOWN"
            try: t_name = t.get_Parameter(BuiltInParameter.SYMBOL_NAME_PARAM).AsString()
            except: 
                try: t_name = t.Name
                except: pass
            
            if t_name == type_name:
                target_type = t
                break
        
        if not target_type:
            try: target_type = tmpl.Duplicate(type_name)
            except: continue
        
        # Set Tag on Type as well?
        try:
            p = target_type.get_Parameter(BuiltInParameter.ALL_MODEL_TYPE_COMMENTS)
            if p: p.Set(TAG_VALUE)
        except: pass

        # Build Layers
        try:
            cs = target_type.GetCompoundStructure()
            if not cs:
                cs = CompoundStructure.CreateSingleLayerCompoundStructure(
                    MaterialFunctionAssignment.Structure, 0.1, ElementId.InvalidElementId)
            
            layers_obj = []
            for layer_def in data["layers"]:
                mat_name = layer_def[0]
                width_ft = m2ft(layer_def[1])
                mat_id = material_cache.get(mat_name, ElementId.InvalidElementId)
                new_layer = CompoundStructureLayer(width_ft, MaterialFunctionAssignment.Structure, mat_id)
                layers_obj.append(new_layer)
                
            cs.SetLayers(layers_obj)
            target_type.SetCompoundStructure(cs)
        except: pass

    # Run the new Opening Logic
    create_opening_types(doc)

    TransactionManager.Instance.TransactionTaskDone()
    print("\nDone. Library v2 (Tagged) Ready.")

build_library()
# ----------------------------------------
update_db = Python()  # CPython3; unwired: IN[0]
# ---------- update_db.python (118 lines) ----------
# -*- coding: utf-8 -*-
import sys
import clr

try:
    clr.AddReference('RevitAPI')
    clr.AddReference('RevitServices')
    from Autodesk.Revit.DB import *
    from RevitServices.Persistence import DocumentManager
    from RevitServices.Transactions import TransactionManager
    doc = DocumentManager.Instance.CurrentDBDocument
    IN_REVIT = True
except ImportError:
    IN_REVIT = False
    print("This script must be run inside Revit.")

# ========================================================
# PDF SOURCE (Materials + Lambda)
# ========================================================
PDF_CONSTRUCTIONS = {
    "MURO EXTERIOR": {
        "layers": [
            ("Mortero de cemento", 0.03, 0.550),
            ("EPS Poliestireno", 0.14, 0.038),
            ("1 pie LP métrico o catalán", 0.24, 0.667),
            ("Mortero de cemento", 0.01, 0.550),
            ("Cámara de aire sin ventilar vertical", 0.05, 0.180),
            ("Placa de yeso laminado", 0.015, 0.250)
        ]
    },
    "MURO DE CÁMARA SANITARIA": {
        "layers": [
            ("Betún fieltro o lámina", 0.009, 0.230),
            ("1 pie LP métrico o catalán", 0.24, 0.667)
        ]
    },
    "TABIQUE INTERIOR": {
        "layers": [
            ("Placa de yeso laminado", 0.013, 0.250),
            ("MW Lana mineral", 0.04, 0.041)
        ]
    },
    "FORJADO INTERIOR (ACOND-ACOND)": {
        "layers": [
            ("Plaqueta de gres", 0.01, 2.300),
            ("Mortero de cemento", 0.05, 0.550),
            ("Mortero de cemento de difusión", 0.065, 0.550),
            ("XPS Expandido", 0.06, 0.034),
            ("FU entrevigado cerámico", 0.25, 0.908),
            ("Cámara de aire sin ventilar horizontal", 0.05, 0.160)
        ]
    },
    "FORJADO CON CÁMARA SANITARIA": {
        "layers": [
            ("Forjado Entrevigado EPS mecanizado", 0.30, 0.256),
            ("Lámina de cloruro de polivinilo (PVC)", 0.005, 0.170)
        ]
    },
    "SOLERA DE CÁMARA SANITARIA": {
        "layers": [
            ("Hormigón en masa", 0.08, 1.650),
            ("Lámina PVC", 0.003, 0.170),
            ("Arena y grava", 0.12, 2.000)
        ]
    },
    "CUBIERTA INCLINADA DE TEJA": {
        "layers": [
            ("Teja de arcilla cocida", 0.015, 1.000),
            ("Cámara aire ventilada, flujo ascend.", 0.05, 0.060),
            ("Betún fieltro o lámina", 0.01, 0.230)
        ]
    }
}

def update_material_model_param():
    if not IN_REVIT: return
    
    TransactionManager.Instance.EnsureInTransaction(doc)
    print("--- UPDATING MATERIAL SCHEDULE DATA ---")
    
    # Track processed to avoid duplicates
    processed_mats = set()
    
    for key, data in PDF_CONSTRUCTIONS.items():
        for layer in data["layers"]:
            mat_name = layer[0]
            k_val = layer[2]
            
            if mat_name in processed_mats: continue
            
            # Find Material
            col = FilteredElementCollector(doc).OfClass(Material)
            target_mat = None
            for m in col:
                if m.Name == mat_name:
                    target_mat = m
                    break
            
            if target_mat:
                # Set 'Model' parameter to the Lambda value
                try:
                    # BuiltInParameter for "Model" property in Identity Data
                    p = target_mat.get_Parameter(BuiltInParameter.ALL_MODEL_MODEL)
                    if p:
                        val_str = str(k_val)
                        p.Set(val_str)
                        print(f"Updated {mat_name}: Model = {val_str}")
                    else:
                        print(f"Param not found for {mat_name}")
                except Exception as e:
                    print(f"Error {mat_name}: {e}")
            
            processed_mats.add(mat_name)

    TransactionManager.Instance.TransactionTaskDone()
    print("\nDone. You can now schedule 'Material: Model' as Conductivity.")

update_material_model_param()
# ----------------------------------------
material_takeoff = Python()  # CPython3; unwired: IN[0]
# ---------- material_takeoff.python (60 lines) ----------
# -*- coding: utf-8 -*-
import sys
import os
import clr

try:
    clr.AddReference('RevitAPI')
    from Autodesk.Revit.DB import *
    from RevitServices.Persistence import DocumentManager
    from RevitServices.Transactions import TransactionManager
    doc = DocumentManager.Instance.CurrentDBDocument
    IN_REVIT = True
except ImportError:
    IN_REVIT = False

# ========================================================
# CONFIGURATION
# ========================================================
# EXACT NAME of the schedule in your Project Browser
SCHEDULE_NAME = "Material Takeoff" 

# Output path
user_home = os.environ['USERPROFILE']
desktop = os.path.join(user_home, "Desktop")
OUTPUT_FILENAME = "CTE_Materials_Export.csv"

def export_schedule_to_csv():
    if not IN_REVIT: return

    # 1. Find the Schedule View
    col = FilteredElementCollector(doc).OfClass(ViewSchedule)
    target_view = None
    
    for v in col:
        if v.Name == SCHEDULE_NAME:
            target_view = v
            break
            
    if not target_view:
        print(f"Error: Could not find a schedule named '{SCHEDULE_NAME}'")
        print("Available Schedules:")
        for v in col: print(f" - {v.Name}")
        return

    # 2. Configure Export Options for CSV
    options = ViewScheduleExportOptions()
    options.Title = True                  # Export Header/Title?
    options.ColumnHeaders = FootnoteColumnHeaders.Export # Export Column Names
    options.FieldDelimiter = ","          # COMMA for CSV
    options.TextQualifier = TextQualifier.DoubleQuote
    
    # 3. Export
    # Note: View.Export takes (Folder, Filename, Options)
    try:
        target_view.Export(desktop, OUTPUT_FILENAME, options)
        print(f"Success! Exported to: {os.path.join(desktop, OUTPUT_FILENAME)}")
    except Exception as e:
        print(f"Error exporting: {e}")

export_schedule_to_csv()
# ----------------------------------------
get_cte_layer_report = Python()  # CPython3; unwired: IN[0]
# ---------- get_cte_layer_report.python (102 lines) ----------
# -*- coding: utf-8 -*-
import sys
import os
import clr

try:
    clr.AddReference('RevitAPI')
    from Autodesk.Revit.DB import *
    from RevitServices.Persistence import DocumentManager
    doc = DocumentManager.Instance.CurrentDBDocument
    IN_REVIT = True
except ImportError:
    IN_REVIT = False

# ========================================================
# CONFIGURATION
# ========================================================
user_home = os.environ['ONEDRIVE']
desktop = os.path.join(user_home, "Desktop")
OUTPUT_FILE = os.path.join(desktop, "CTE_Layer_Report.csv")

def m2ft(meters): return meters * 3.28084
def ft2m(feet): return feet * 0.3048

def get_safe_mat_name(doc, mat_id):
    if mat_id == ElementId.InvalidElementId: return "No Material"
    try:
        return doc.GetElement(mat_id).Name
    except:
        return "Unknown Material"

def run_layer_export():
    if not IN_REVIT: return

    # Categories to scan
    cats = [
        (WallType, "Wall"),
        (FloorType, "Floor"),
        (RoofType, "Roof")
    ]
    
    lines = []
    # Header
    lines.append("Category,Type Name,Total Thickness (m),Layer Index,Material Name,Layer Thickness (m),Conductivity (Model Param)")

    print("--- SCANNING TYPES ---")

    for class_type, cat_name in cats:
        col = FilteredElementCollector(doc).OfClass(class_type).WhereElementIsElementType()
        
        for t in col:
            # 1. Get Type Name safely
            try:
                t_name = t.get_Parameter(BuiltInParameter.SYMBOL_NAME_PARAM).AsString()
            except:
                t_name = t.Name
            
            if not t_name: t_name = "Unnamed Type"

            # 2. Get Compound Structure (The Layers)
            try:
                cs = t.GetCompoundStructure()
            except:
                cs = None
                
            if not cs: continue 

            # --- FIX: Use cs.GetWidth() instead of t.Width ---
            # This works for Walls, Floors, and Roofs
            total_width = ft2m(cs.GetWidth())
            
            layers = cs.GetLayers()
            
            print(f"Exporting: {t_name}")

            # 3. Iterate Layers
            for i, layer in enumerate(layers):
                width_m = ft2m(layer.Width)
                mat_name = get_safe_mat_name(doc, layer.MaterialId)
                
                # Try to get Lambda from the Material's "Model" parameter
                lambda_val = ""
                if layer.MaterialId != ElementId.InvalidElementId:
                    try:
                        mat = doc.GetElement(layer.MaterialId)
                        p = mat.get_Parameter(BuiltInParameter.ALL_MODEL_MODEL)
                        if p and p.HasValue: lambda_val = p.AsString()
                    except: pass
                
                # CSV Format
                row = f'"{cat_name}","{t_name}",{total_width:.4f},{i+1},"{mat_name}",{width_m:.4f},"{lambda_val}"'
                lines.append(row)

    # WRITE TO FILE
    try:
        with open(OUTPUT_FILE, 'w', encoding='utf-8') as f:
            f.write("\n".join(lines))
        print(f"\nSuccess! Exported to: {OUTPUT_FILE}")
    except Exception as e:
        print(f"Error writing file: {e}")

run_layer_export()
# ----------------------------------------
load_db_from_json = Python()  # CPython3; unwired: IN[0]
# ---------- load_db_from_json.python (130 lines) ----------
# -*- coding: utf-8 -*-
import clr
import sys
import re
import json
import os

# Add Revit API References
clr.AddReference('RevitAPI')
clr.AddReference('RevitServices')
from Autodesk.Revit.DB import *
from RevitServices.Persistence import DocumentManager
from RevitServices.Transactions import TransactionManager

# Set the document
doc = DocumentManager.Instance.CurrentDBDocument

# ============================================================================
# CONFIGURATION
# ============================================================================
JSON_PATH = r"C:\ProyectosCTEyCEE\CTEHE2019\Proyectos\EjemploI_2526_Option1_Config1\output\materials.json"

# ============================================================================
# HELPER FUNCTIONS
# ============================================================================

def clean_material_name(raw_name):
    """
    Fixes encoding and applies the 'a < d < b' -> 'd entre a y b' rule.
    """
    if not raw_name: return "Material_Sin_Nombre"
    
    # 1. Fix encoding/accents (Ensure we are working with unicode)
    # IronPython 2.7 string handling can be tricky with JSON. 
    # Usually simple assignment works if the file is read correctly.
    clean = raw_name
    
    # 2. Apply Rule: "750 < d < 900" becomes "d entre 750 y 900"
    # Regex explains: Look for number, space?, <, space?, d, space?, <, space?, number
    pattern = r"(\d+)\s*<\s*d\s*<\s*(\d+)"
    replacement = r"d entre \1 y \2"
    
    clean = re.sub(pattern, replacement, clean)
    
    return clean

def get_or_create_material(doc, name):
    """
    Finds a material by name or creates it.
    Returns the Material element.
    """
    # Try to find existing
    collector = FilteredElementCollector(doc).OfClass(Material)
    for mat in collector:
        if mat.Name == name:
            return mat
            
    # If not found, create new
    new_id = Material.Create(doc, name)
    return doc.GetElement(new_id)

def set_param(elem, built_in_param, value):
    """Safe parameter setter"""
    p = elem.get_Parameter(built_in_param)
    if p and value is not None:
        # Convert numbers to string for text params
        if isinstance(value, float):
            p.Set(str(value))
        else:
            p.Set(str(value))

# ============================================================================
# MAIN EXECUTION
# ============================================================================
def main():
    if not os.path.exists(JSON_PATH):
        return "Error: File not found at {}".format(JSON_PATH)

    # Read JSON
    with open(JSON_PATH, 'r') as f:
        data = json.load(f)

    # Start Transaction
    TransactionManager.Instance.EnsureInTransaction(doc)
    
    report = []
    
    try:
        for item in data:
            raw_name = item.get('name', 'Unnamed')
            props = item.get('properties', {})
            
            # 1. Clean the name
            final_name = clean_material_name(raw_name)
            
            # 2. Get or Create (The "Upsert")
            mat = get_or_create_material(doc, final_name)
            
            # 3. Update Identity Data
            # Map "group" from JSON to Revit "Class"
            group = item.get('group', 'General')
            set_param(mat, BuiltInParameter.MATERIAL_PARAM_CLASS, group)
            
            # Map "conductivity" to "Model" (for Schedules)
            k_val = props.get('conductivity', 0)
            set_param(mat, BuiltInParameter.ALL_MODEL_MODEL, k_val)
            
            # Map "density" to "Description"
            d_val = props.get('density', 0)
            desc_str = "Density: {} kg/m3".format(d_val)
            set_param(mat, BuiltInParameter.ALL_MODEL_DESCRIPTION, desc_str)
            
            # Map "specific_heat" to "Comments"
            cp_val = props.get('specific_heat', 0)
            comment_str = "Cp: {} J/kgK".format(cp_val)
            set_param(mat, BuiltInParameter.ALL_MODEL_INSTANCE_COMMENTS, comment_str)

            report.append("Processed: {}".format(final_name))

        TransactionManager.Instance.TransactionTaskDone()
        return "Success. Processed {} materials.".format(len(report))
        
    except Exception as e:
        TransactionManager.Instance.ForceCloseTransaction()
        return "Error: {}".format(str(e))

# Run the script
if __name__ == "__main__":
    result = main()
    print(result) # Or OUT = result in Dynamo
# ----------------------------------------
